% Simulink data dictionary StateMachine.sldd

ContactorState = enum(DefaultValue="Faulted", StorageType="uint8", AddClassNameToEnumNames=true)
  Faulted = 0
  Close = 1
  Open = 2

VehicleState = enum(DefaultValue="Off", StorageType="uint8", AddClassNameToEnumNames=true)
  Off = 0
  PrechargeReady = 1
  Precharge = 2
  PrechargeComplete = 3
  Standby = 4
  ReadyToMove = 5
  Faulted = 6