% Simulink data dictionary IO.sldd

DigitalPolarity = enum(DefaultValue="ActiveLow", StorageType="uint8", AddClassNameToEnumNames=true)
  ActiveLow = 0
  ActiveHigh = 1

Vref = Simulink.Parameter(5, DataType="single", Unit="V")  % Voltage reference used for analog to digital conversion
ADCBits = Simulink.Parameter(12, DataType="single")  % ADC resolution on the target controller